# Grasshopper definition windrose_plot.gh (Grasshopper 1.0.7)

panel = Panel("https://www.energyplus.net/weather-download/asia_wmo_region_2/CHN//CHN_Beijing.Beijing.545110_SWERA/all")
downloadepw = LBDownloadWeather(weather_URL=panel)  # -> epw_file, stat_file, ddy_file; plug-in component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
importepw = LBImportEPW(epw_file=downloadepw.epw_file)  # -> location, dry_bulb_temperature, dew_point_temperature, relative_humidity, wind_speed, wind_direction, direct_normal_rad, diffuse_horizontal_rad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; plug-in component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
pt = Point(Point(262.9122548, -200.8719773, 0))
windrose = LBWindRosePlot(
    north=Slider(0, range=0..100),
    wind_speed_data=importepw.wind_speed,
    wind_direction_data=importepw.wind_direction,
    number_of_directions=Slider(16, range=0..20),
    center_pt=pt,
    show_calmrose=Toggle(False),
    show_frequency=Toggle(True),
    frequency_distance=Slider(10, range=0..10),
    frequency_hours=Slider(100, range=0..100),
    max_frequency=Slider(900, range=0..10000))  # -> report, wind_histogram_data, mesh, compass, orientation_lines, frequency_lines, legend, title; plug-in component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
